# Grasshopper definition simple_gh.gh (Grasshopper 1.0.7)

# import pts
path = FilePath("/Users/mnomayr/Documents/OE_Design_Workflow/simple_gh/input.csv")
panel = Panel(path)
file = ReadFile(File=path, PerLineParse=True)
pline = PolyLine(Vertices=file, Closed=invert(False))
area = Area(Geometry=pline)  # -> Area, Centroid
panel_2 = Panel(area.Area)
